# Grasshopper definition TopDown.gh (Grasshopper 1.0.7)

c_script = CSharpScript(radius=Slider(10, range=0..10), amplitude=Slider(1.175, range=0..10), iter=Slider(10, range=0..10))  # -> out, A; inputs radius: Double, amplitude: Double, iter: Int32
# ---------- c_script: C# ----------
    List<Circle> circles = new List<Circle>();
    double r = radius;

    for( int i = iter - 1; i >= 0; --i )
    {

      circles.Add(new Circle(radius));
      radius *= amplitude;

    }

    A = circles;
# ---------- end c_script ----------
number_slider = Slider(0.5, range=0..1)
c_script_2 = CSharpScript(circlesIn=c_script.A, divide=Slider(8, range=0..100))  # -> out, A; inputs circlesIn: list of Curve, divide: Int32
# ---------- c_script_2: C# ----------
    DataTree<Point3d> pointsOut = new DataTree<Point3d>();
    double tX = 1.0 / divide;
    Random rand = new Random();
    for( int i = 0; i < circlesIn.Count; ++i )
    {

      GH_Path path = new GH_Path(i);
      Curve temp = circlesIn[i];

      double t = 0.0;

      for( int j = 0; j < divide + 2; ++j )
      {

        pointsOut.Add(temp.PointAtNormalizedLength(t), path);
        t += tX + ( rand.Next(0,100) * 0.0001 );

      }

    }

    DataTree<Point3d> objectsOut = new DataTree<Point3d>();

    for( int i = 0; i < pointsOut.BranchCount - 1; ++i )
    {

      //GH_Path path = pointsOut.Path(i);
      //List<Point3d> pts = new List<Point3d>();
      int mod = i % 2;

      for( int j = 0; j < pointsOut.Branch(i).Count - 2; ++j )
      {


        Point3d pointA = mod % 2 == 1 ? pointsOut.Branch(i)[j] : pointsOut.Branch(i)[j + 1];
        Point3d pointB = mod % 2 == 0 ? pointsOut.Branch(i + 1)[j + 1] : pointsOut.Branch(i + 1)[j + 2];
        Point3d pointC = mod % 2 == 0 ? pointsOut.Branch(i + 1)[j] : pointsOut.Branch(i + 1)[j + 1];
        Point3d pointD = midPoint(pointB, pointC);
        GH_Path path = new GH_Path(i);
        objectsOut.Add(pointA, path);
        objectsOut.Add(pointD, path);
        objectsOut.Add(pointC, path);
        //objectsOut.Add( tempPoly, path );
        //objectsOut.Add( new Line( pointA, pointB ), path );


      }

      //objectsOut.AddRange( pts, path );



    }

    A = objectsOut;
# ---------- c_script_2: C# additional code ----------
  Point3d midPoint(Point3d pointA, Point3d pointB)
  {

    return new Point3d(0.5 * pointA.X + 0.5 * pointA.X, 0.5 * pointA.Y + 0.5 * pointA.Y, 0.5 * pointA.Z + 0.5 * pointA.Z);

  }
# ---------- end c_script_2 ----------
series = Series(Start=0, Step=Slider(0.1, range=0..0.1), Count=10)
dom = ConstructDomain(DomainStart=0, DomainEnd=Slider(0, range=0..10))
dom_2 = ConstructDomain(DomainStart=0, DomainEnd=series)
points = PointList(Points=c_script_2.A)
graph = GraphMapper(series, x0=0, x1=1, y0=0, y1=1, Ox=0.5020717382, Oy=0.5734367967, Px=0.6279452443, Py=1, container_name="Parabola")
nurbs = NurbsCurve(Vertices=c_script_2.A, Degree=Slider(11, range=0..100), Periodic=True)  # -> flatten(Curve), Length, Domain
multiplication = Multiplication(A=graph, B=10)
Z = UnitZ(Factor=multiplication)
panel = Panel(graph)
move = Move(Geometry=reverse(nurbs.Curve), Motion=Z)  # -> Geometry, Transform
loft = Loft(Curves=move.Geometry, Options={Adjust=False, Closed=False, LoftEnds=0, LoftSimp=0, LoftType=0, Rebuild=10, Refit=0.01})
